# Grasshopper definition ChatGPT_003.gh (Grasshopper 1.0.7)
# plug-ins: Human

panel = Panel("Write my an expression that will work with three variables x and y and z in the expression node in grasshopper for rhino3d that will generate some cool geometry.  Make sure that the expression has no white space before or after the equation.")
panel_2 = Panel("Write my an expression that will work with three variables x and y and z in the expression node in grasshopper for rhino3d that will generate some cool geometry.  Make sure that the expression has no white space before or after the equation.")
trigger = Trigger(Interval=500, TimerInterval=500, Target=data_recorder)  # disabled
data_recorder = DataRecorder("1", DataLimit=-10, RecordData=False)
list_length = ListLength(List=data_recorder)
testnumbereven = TestNumberEven(num=list_length)  # -> out, IsEven; inputs num: Int32
# ---------- testnumbereven: C# ----------
    int mod = num % 2;
    IsEven = (mod == 0 ? true : false);
# ---------- end testnumbereven ----------
panel_3 = Panel("C:\Users\Sculpture\Desktop\Openai\Key\KeyMichaelWickerson.txt")
panel_4 = Panel(testnumbereven.IsEven)
button = Button()
send = BooleanToggle(True)
file = ReadFile(File=panel_3, PerLineParse=True)
number_slider = Slider(2, range=0..10)
chatgpt = GhPythonScript(api_key=file, request=panel, send=panel_4)  # -> answer; inputs send: Boolean
# ---------- chatgpt: Python ----------
__author__ = "peter"
__version__ = "2023.01.18"

#calling peters api key on local files, to do: add in more json promts that link to api calls. could be good for uv map generations. 

import rhinoscriptsyntax as rs
import urllib2
import json


url = "https://api.openai.com/v1/completions"


data = json.dumps({ "model": "text-davinci-003", "prompt": request, "temperature": 0.5,  "max_tokens": 1024})
headers = { "Content-Type": "application/json", "Authorization": "Bearer {0}".format(api_key) }

answer = "Send to request to Open AI"

if send:

    req = urllib2.Request(url, data, headers)
    response = urllib2.urlopen(req)


    response_text = response.read()
    response_json = json.loads(response_text)


    answer = response_json["choices"][0]["text"]

print(answer)
# ---------- end chatgpt ----------
chatgpt_2 = GhPythonScript(api_key=file, request=panel_2, send=panel_4)  # -> answer; inputs send: Boolean; same code as chatgpt
panel_5 = Panel(file)
panel_6 = Panel(chatgpt)
panel_7 = Panel(chatgpt_2)
negative = Negative(Value=number_slider)
panel_8 = Panel(panel_6)
construct_domain = ConstructDomain(DomainStart=negative, DomainEnd=number_slider)
text_trim = TextTrim(Text=panel_6, Start=True, End=True)
text_trim_2 = TextTrim(Text=panel_7, Start=True, End=True)
panel_9 = Panel(text_trim)
panel_10 = Panel(text_trim_2)
range = Range(Domain=construct_domain, Steps=Slider(100, range=0..100))
evaluate = Evaluate(Expression=panel_9, x=number_slider, y=range, z=range)
evaluate_2 = Evaluate(Expression=panel_10, x=number_slider, y=range, z=range)
panel_11 = Panel(evaluate)
construct_point = ConstructPoint(XCoordinate=range, YCoordinate=evaluate_2, ZCoordinate=evaluate)
interpolate = Interpolate(Vertices=construct_point, Degree=3, Periodic=False, KnotStyle=1)  # -> Curve, Length, Domain
end_points = EndPoints(Curve=interpolate.Curve)  # -> Start, End
line = Line(StartPoint=end_points.Start, EndPoint=end_points.End)
revolution = Revolution(Curve=interpolate.Curve, Axis=line, Domain=Domain(0, 6.283185307))
bake_geometry = BakeGeometry(Bake=panel_4, Geometry=revolution, DeleteOldBakes=False, PreserveTrees=False)
