# Grasshopper definition ChatGPT_GH006.gh (Grasshopper 1.0.7)
# plug-ins: Human

panel = Panel("generate a trigonometric polynimial expressions that use the * symbol for multiplication  for the expression node in grasshopper for rhino3d")
trigger = Trigger(Interval=20, TimerInterval=20, Target=data_recorder)  # disabled
data_recorder = DataRecorder("1", DataLimit=-10, RecordData=False)
number_slider = Slider(169, range=0..169)
list_length = ListLength(List=data_recorder)
panel_2 = Panel("C:\Users\Sculpture\Desktop\Openai\Key\KeyMichaelWickerson.txt")
testnumbereven = TestNumberEven(num=list_length)  # -> out, IsEven; inputs num: Int32
# ---------- testnumbereven: C# ----------
    int mod = num % 2;
    IsEven = (mod == 0 ? true : false);
# ---------- end testnumbereven ----------
curve = Curve([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])
panel_3 = Panel(testnumbereven.IsEven)
number_slider_2 = Slider(12, range=0..100)
button = Button()
send = BooleanToggle(True)
list_item = ListItem(List=curve, Index=number_slider, Wrap=True)
curve_2 = Curve(list_item)
square = Square(Plane=PlaneXY(0, 0, 0), Size=Slider(2, range=0..10), ExtentX=number_slider_2, ExtentY=number_slider_2)  # -> Cells, flatten(Points)
end_points = EndPoints(Curve=curve_2)  # -> Start, End
file = ReadFile(File=panel_2, PerLineParse=True)
number_slider_3 = Slider(1, range=0..1)
chatgpt = GhPythonScript(api_key=file, request=panel, send=panel_3)  # -> answer; inputs send: Boolean
# ---------- chatgpt: Python ----------
__author__ = "peter"
__version__ = "2023.01.18"

#calling peters api key on local files, to do: add in more json promts that link to api calls. could be good for uv map generations. 

import rhinoscriptsyntax as rs
import urllib2
import json


url = "https://api.openai.com/v1/completions"


data = json.dumps({ "model": "text-davinci-003", "prompt": request, "temperature": 0.5,  "max_tokens": 1024})
headers = { "Content-Type": "application/json", "Authorization": "Bearer {0}".format(api_key) }

answer = "Send to request to Open AI"

if send:

    req = urllib2.Request(url, data, headers)
    response = urllib2.urlopen(req)


    response_text = response.read()
    response_json = json.loads(response_text)


    answer = response_json["choices"][0]["text"]

print(answer)
# ---------- end chatgpt ----------
chatgpt_2 = GhPythonScript(api_key=file, request=panel, send=panel_3)  # -> answer; inputs send: Boolean; same code as chatgpt
list_item_2 = ListItem(List=square.Points, Index=number_slider, Wrap=True)
line = Line(StartPoint=end_points.Start, EndPoint=end_points.End)
panel_4 = Panel(file)
panel_5 = Panel(chatgpt)
panel_6 = Panel(chatgpt_2)
curve_middle = CurveMiddle(Curve=line)
curve_middle_2 = CurveMiddle(Curve=curve_2)
negative = Negative(Value=number_slider_3)
vector_2pt = Vector2Pt(PointA=curve_middle_2, PointB=curve_middle, Unitize=False)  # -> Vector, Length
xz_plane = XZPlane(Origin=Point(0, 0, 0))
text_trim = TextTrim(Text=panel_5, Start=True, End=True)
construct_domain = ConstructDomain(DomainStart=negative, DomainEnd=number_slider_3)
text_trim_2 = TextTrim(Text=panel_6, Start=True, End=True)
cross_product = CrossProduct(VectorA=vector_2pt.Vector, VectorB=xz_plane, Unitize=False)  # -> Vector, Length
move = Move(Geometry=curve_2, Motion=vector_2pt.Vector)  # -> Geometry, Transform
panel_7 = Panel(text_trim)
panel_8 = Panel(text_trim_2)
loft = Loft(
    Curves=[curve_2, move.Geometry],
    Options={Adjust=False, Closed=False, LoftEnds=0, LoftSimp=0, LoftType=0, Rebuild=10, Refit=0.01})
range = Range(Domain=construct_domain, Steps=Slider(50, range=0..100))
evaluate = Evaluate(Expression=panel_7, x=range, y=range, z=range)
evaluate_2 = Evaluate(Expression=panel_8, x=range, y=range, z=range)
extrude = Extrude(Base=loft, Direction=cross_product.Vector)
volume = Volume(Geometry=extrude)  # -> Volume, Centroid
orient = Orient(Geometry=extrude, Source=volume.Centroid, Target=list_item_2)  # -> Geometry, Transform
bake_geometry = BakeGeometry(Bake=Toggle(True), Geometry=orient.Geometry, DeleteOldBakes=False, PreserveTrees=False)
panel_9 = Panel(evaluate)
construct_point = ConstructPoint(XCoordinate=evaluate, YCoordinate=range, ZCoordinate=evaluate_2)
interpolate = Interpolate(Vertices=construct_point, Degree=3, Periodic=False, KnotStyle=1)  # -> Curve, Length, Domain
bake_geometry_2 = BakeGeometry(Bake=panel_3, Geometry=interpolate.Curve, DeleteOldBakes=False, PreserveTrees=False)
