# Grasshopper definition ChatGPT_GH010.gh (Grasshopper 1.0.7)
# plug-ins: Human

# ----
# HOW I USED TO TALK TO CHATGPT
# generate the C# script for a C# node in grasshopper that produces two beautiful trigonometry curves that can be output lofted
# HOW CHATGPT TAUGHT ME TO TALK TO CHATGPT
# create two difference trigonometric polynomials with three variables each x, y, and z.
# 
# Make sure that the * operator is used whenever a multiplcation is taking place in the polynomial.
# 
# Do not number the equeations.
# 
# Separate the two equations with the symbol "&"
# create two difference trigonometric polynomials with three variables each x, y, and z.
# 
# Make sure that the * operator is used whenever a multiplcation is taking place in the polynomial.
# 
# Do not number the equeations.
# 
# Separate the two equations with the symbol "&"
# 
# Only use sin, cos, and tan functions.
# create two difference trigonometric polynomials with three variables each x, y, and z.
# create two difference trigonometric polynomials with three variables each x, y, and z.
# 
# Make sure that the * operator is used whenever a multiplcation is taking place in the polynomial.
panel = Panel("""create two difference trigonometric polynomials with three variables each x, y, and z.

Make sure that the * operator is used whenever a multiplcation is taking place in the polynomial.

Do not number the equeations.

Separate the two equations with the symbol "&"

Only use sin, cos functions.

Be sure to use a lot of rotation.""")

trigger = Trigger(Interval=2000, TimerInterval=2000, Target=data_recorder)  # disabled
panel_2 = Panel("C:\Users\Sculpture\Desktop\Openai\Key\KeyMichaelWickerson.txt")
data_recorder = DataRecorder("1", DataLimit=-10, RecordData=False)
list_length = ListLength(List=data_recorder)
testnumbereven = TestNumberEven(num=list_length)  # -> out, IsEven; inputs num: Int32
# ---------- testnumbereven: C# ----------
    int mod = num % 2;
    IsEven = (mod == 0 ? true : false);
# ---------- end testnumbereven ----------
panel_3 = Panel(list_length)
send = BooleanToggle(True)
file = ReadFile(File=panel_2, PerLineParse=True)
panel_4 = Panel(testnumbereven.IsEven)
chatgpt = GhPythonScript(api_key=file, request=panel, send=panel_4)  # -> answer; inputs send: Boolean
# ---------- chatgpt: Python ----------
__author__ = "peter"
__version__ = "2023.01.18"

#calling peters api key on local files, to do: add in more json promts that link to api calls. could be good for uv map generations. 

import rhinoscriptsyntax as rs
import urllib2
import json


url = "https://api.openai.com/v1/completions"


data = json.dumps({ "model": "text-davinci-003", "prompt": request, "temperature": 0.5,  "max_tokens": 1024})
headers = { "Content-Type": "application/json", "Authorization": "Bearer {0}".format(api_key) }

answer = "Send to request to Open AI"

if send:

    req = urllib2.Request(url, data, headers)
    response = urllib2.urlopen(req)


    response_text = response.read()
    response_json = json.loads(response_text)


    answer = response_json["choices"][0]["text"]

print(answer)
# ---------- end chatgpt ----------
panel_5 = Panel(file)
panel_6 = Panel(chatgpt)
number_slider = Slider(1.812, range=0..10)
text_split = TextSplit(Text=panel_6, Separators="&")
negative = Negative(Value=number_slider)
text_trim = TextTrim(Text=text_split, Start=True, End=True)
construct_domain = ConstructDomain(DomainStart=negative, DomainEnd=number_slider)
dispatch = Dispatch(List=text_trim, DispatchPattern=[True, False])  # -> ListA, ListB
range = Range(Domain=construct_domain, Steps=Slider(100, range=0..100))
panel_7 = Panel(dispatch.ListB)
panel_8 = Panel(dispatch.ListA)
evaluate = Evaluate(Expression=dispatch.ListA, x=range, y=range, z=range)
evaluate_2 = Evaluate(Expression=dispatch.ListB, x=range, y=range, z=range)
construct_point = ConstructPoint(XCoordinate=range, YCoordinate=evaluate, ZCoordinate=evaluate_2)
construct_point_2 = ConstructPoint(XCoordinate=0, YCoordinate=panel_3, ZCoordinate=0)
interpolate = Interpolate(Vertices=construct_point, Degree=3, Periodic=False, KnotStyle=1)  # -> Curve, Length, Domain
curve_middle = CurveMiddle(Curve=interpolate.Curve)
orient = Orient(Geometry=interpolate.Curve, Source=curve_middle, Target=construct_point_2)  # -> Geometry, Transform
bake_geometry = BakeGeometry(Bake=panel_4, Geometry=orient.Geometry, DeleteOldBakes=False, PreserveTrees=False)
