# Grasshopper definition ChatGPT_GH012.gh (Grasshopper 1.0.7)
# plug-ins: Human

number_slider = Slider(-1, range=-1..1)
trigger = Trigger(Interval=2000, TimerInterval=2000, Target=data_recorder)  # disabled
# HOW I USED TO TALK TO CHATGPT
panel = Panel("C:\Users\Sculpture\Desktop\Openai\Key\KeyMichaelWickerson.txt")
data_recorder = DataRecorder("1", DataLimit=-10, RecordData=False)
curve = Curve([<curve referenced from the Rhino model> x4])
list_item = ListItem(List=curve, Index=0, Wrap=True)  # -> Item, Item1, Item2, Item3, Item4, Item5

trigger_2 = Trigger(Interval=50, TimerInterval=50, Target=data_recorder_2)  # disabled
data_recorder_2 = DataRecorder("1", DataLimit=10000, RecordData=False)
list_length = ListLength(List=data_recorder_2)
panel_2 = Panel(list_length)
division = Division(A=panel_2, B=Slider(20, range=1..20))
pi = Pi(Factor=1)
cosine = Cosine(Value=division)
sine = Sine(Value=division)
multiplication = Multiplication(A=cosine, B=pi)
absolute = Absolute(Value=sine)
absolute_2 = Absolute(Value=multiplication)
addition = Addition(A=absolute_2, B=absolute)
panel_3 = Panel([cosine, sine])

multiplication_2 = Multiplication(A="2", B=sine)
multiplication_3 = Multiplication(A="2", B=cosine)
list_length_2 = ListLength(List=data_recorder)
curve_2 = Curve(list_item.Item2)
curve_3 = Curve(list_item.Item1)
curve_4 = Curve(list_item.Item3)
curve_5 = Curve(list_item.Item)
end_points = EndPoints(Curve=curve_4)  # -> Start, End
end_points_2 = EndPoints(Curve=curve_2)  # -> Start, End
testnumbereven = TestNumberEven(num=list_length_2)  # -> out, IsEven; inputs num: Int32
# ---------- testnumbereven: C# ----------
    int mod = num % 2;
    IsEven = (mod == 0 ? true : false);
# ---------- end testnumbereven ----------
panel_4 = Panel(list_length_2)
send = BooleanToggle(True)
vector_xyz = VectorXYZ(XComponent=0, YComponent="1", ZComponent=0)  # -> Vector, Length
vector_xyz_2 = VectorXYZ(XComponent=0, YComponent="1", ZComponent=0)  # -> Vector, Length
file = ReadFile(File=panel, PerLineParse=True)
panel_5 = Panel(testnumbereven.IsEven)
# generate the C# script for a C# node in grasshopper that produces two beautiful trigonometry curves that can be output lofted
panel_6 = Panel(file)
pi_2 = Pi(Factor=multiplication_2)
pi_3 = Pi(Factor=multiplication_3)
line_sdl = LineSDL(Start=end_points.Start, Direction=vector_xyz.Vector, Length=1)
line_sdl_2 = LineSDL(Start=end_points_2.Start, Direction=vector_xyz_2.Vector, Length=1)
end_points_3 = EndPoints(Curve=curve_5)  # -> Start, End
end_points_4 = EndPoints(Curve=curve_3)  # -> Start, End
rotate_axis = RotateAxis(Geometry=curve_4, Angle=pi_2, Axis=line_sdl)  # -> Geometry, Transform
rotate_axis_2 = RotateAxis(Geometry=curve_2, Angle=pi_3, Axis=line_sdl_2)  # -> Geometry, Transform
number_slider_2 = Slider(1.812, range=0..10)
mirror = Mirror(Geometry=rotate_axis.Geometry, Plane=PlaneYZ(0, 0, 0))  # -> Geometry, Transform
mirror_2 = Mirror(Geometry=rotate_axis_2.Geometry, Plane=PlaneYZ(0, 0, 0))  # -> Geometry, Transform
orient = Orient(Geometry=rotate_axis_2.Geometry, Source=end_points_2.Start, Target=end_points_3.Start)  # -> Geometry, Transform
orient_2 = Orient(Geometry=rotate_axis.Geometry, Source=end_points.Start, Target=end_points_4.Start)  # -> Geometry, Transform
negative = Negative(Value=number_slider_2)
loft = Loft(
    Curves=[curve_5, curve_3],
    Options={Adjust=False, Closed=False, LoftEnds=0, LoftSimp=0, LoftType=0, Rebuild=10, Refit=0.01})
end_points_5 = EndPoints(Curve=mirror.Geometry)  # -> Start, End
orient_3 = Orient(Geometry=mirror.Geometry, Source=end_points_5.Start, Target=end_points_4.End)  # -> Geometry, Transform
end_points_6 = EndPoints(Curve=mirror_2.Geometry)  # -> Start, End
orient_4 = Orient(Geometry=mirror_2.Geometry, Source=end_points_6.Start, Target=end_points_3.End)  # -> Geometry, Transform
construct_domain = ConstructDomain(DomainStart=negative, DomainEnd=number_slider_2)
end_points_7 = EndPoints(Curve=orient_2.Geometry)  # -> Start, End
end_points_8 = EndPoints(Curve=orient_3.Geometry)  # -> Start, End
line = Line(StartPoint=end_points_7.End, EndPoint=end_points_8.End)
range = Range(Domain=construct_domain, Steps=Slider(100, range=0..100))
curve_middle = CurveMiddle(Curve=curve_5)
curve_middle_2 = CurveMiddle(Curve=line)
vector_2pt = Vector2Pt(PointA=curve_middle_2, PointB=curve_middle, Unitize=False)  # -> Vector, Length
yz_plane = YZPlane(Origin=Point(0, 0, 0))
move = Move(Geometry=curve_5, Motion=vector_2pt.Vector)  # -> Geometry, Transform

# ----
# HOW CHATGPT TAUGHT ME TO TALK TO CHATGPT
# create two difference trigonometric polynomials with three variables each x, y, and z.
# 
# Make sure that the * operator is used whenever a multiplcation is taking place in the polynomial.
# 
# Do not number the equeations.
# 
# Separate the two equations with the symbol "&"
# create two difference trigonometric polynomials with three variables each x, y, and z.
# 
# Make sure that the * operator is used whenever a multiplcation is taking place in the polynomial.
# 
# Do not number the equeations.
# 
# Separate the two equations with the symbol "&"
# 
# Only use sin, cos, and tan functions.
# create two difference trigonometric polynomials with three variables each x, y, and z.
# create two difference trigonometric polynomials with three variables each x, y, and z.
# 
# Make sure that the * operator is used whenever a multiplcation is taking place in the polynomial.
panel_7 = Panel("""create two difference trigonometric polynomials with three variables each x, y, and z.

Make sure that the * operator is used whenever a multiplcation is taking place in the polynomial.

Do not number the equeations.

Separate the two equations with the symbol "&"

Only use sin, cos functions.

Be sure to use a lot of rotation.""")

chatgpt = GhPythonScript(api_key=file, request=panel_7, send=panel_5)  # -> answer; inputs send: Boolean
# ---------- chatgpt: Python ----------
__author__ = "peter"
__version__ = "2023.01.18"

#calling peters api key on local files, to do: add in more json promts that link to api calls. could be good for uv map generations. 

import rhinoscriptsyntax as rs
import urllib2
import json


url = "https://api.openai.com/v1/completions"


data = json.dumps({ "model": "text-davinci-003", "prompt": request, "temperature": 0.5,  "max_tokens": 1024})
headers = { "Content-Type": "application/json", "Authorization": "Bearer {0}".format(api_key) }

answer = "Send to request to Open AI"

if send:

    req = urllib2.Request(url, data, headers)
    response = urllib2.urlopen(req)


    response_text = response.read()
    response_json = json.loads(response_text)


    answer = response_json["choices"][0]["text"]

print(answer)
# ---------- end chatgpt ----------
panel_8 = Panel(chatgpt)
text_split = TextSplit(Text=panel_8, Separators="&")
text_trim = TextTrim(Text=text_split, Start=True, End=True)
dispatch = Dispatch(List=text_trim, DispatchPattern=[True, False])  # -> ListA, ListB
panel_9 = Panel(dispatch.ListB)
panel_10 = Panel(dispatch.ListA)
evaluate = Evaluate(Expression=dispatch.ListA, x=range, y=range, z=range)
evaluate_2 = Evaluate(Expression=dispatch.ListB, x=range, y=range, z=range)
construct_point = ConstructPoint(XCoordinate=range, YCoordinate=evaluate, ZCoordinate=evaluate_2)
interpolate = Interpolate(Vertices=construct_point, Degree=3, Periodic=False, KnotStyle=1)  # -> Curve, Length, Domain
construct_point_2 = ConstructPoint(XCoordinate=0, YCoordinate=panel_4, ZCoordinate=0)
loft_2 = Loft(
    Curves=[curve_5, move.Geometry],
    Options={Adjust=False, Closed=False, LoftEnds=0, LoftSimp=0, LoftType=0, Rebuild=10, Refit=0.01})
cross_product = CrossProduct(VectorA=[vector_xyz_2.Vector, vector_2pt.Vector], VectorB=yz_plane, Unitize=Toggle(True))  # -> Vector, Length
merge = Merge(Data1=orient.Geometry, Data2=orient_4.Geometry, Data3=orient_2.Geometry, Data4=orient_3.Geometry)
curve_middle_3 = CurveMiddle(Curve=interpolate.Curve)
extrude = Extrude(Base=loft_2, Direction=cross_product.Vector)
extrude_2 = Extrude(Base=loft, Direction=cross_product.Vector)
pipe = Pipe(Curve=graft(merge), Radius=Slider(0.415, range=0..1), Caps="2")  # -> flatten(Pipe)
orient_5 = Orient(Geometry=interpolate.Curve, Source=curve_middle_3, Target=construct_point_2)  # -> Geometry, Transform
merge_2 = Merge(Data1=pipe, Data2=extrude_2, Data3=extrude)
bake_geometry = BakeGeometry(Bake=panel_5, Geometry=orient_5.Geometry, DeleteOldBakes=False, PreserveTrees=False)
solid_union = SolidUnion(Breps=merge_2)
panel_11 = Panel(solid_union)
