# Grasshopper definition ChatGPT_GH016.gh (Grasshopper 1.0.7)
# plug-ins: ScriptParasite, Kangaroo2 Components, Fologram For Grasshopper Utilities, Human

trigger = Trigger(Interval=20, TimerInterval=20, Target=data_recorder)  # disabled
data_recorder = DataRecorder("1", DataLimit=10000, RecordData=False)
list_length = ListLength(List=data_recorder)
panel = Panel(list_length)
division = Division(A=panel, B=Slider(159, range=1..220))
pi = Pi(Factor=1)
cosine = Cosine(Value=division)
sine = Sine(Value=division)
multiplication = Multiplication(A=cosine, B=pi)
absolute = Absolute(Value=sine)
absolute_2 = Absolute(Value=multiplication)
addition = Addition(A=absolute_2, B=absolute)
panel_2 = Panel([cosine, sine])

trigger_2 = Trigger(Interval=2000, TimerInterval=2000, Target=data_recorder_2)  # disabled
# //Write the c# script for the following psuedo code for the c# node in grasshopper for Rhino3d
# 
# //Create an instance of a point and initialize to x, y and z
# 
#     //Assign the point "pt" to output
# //Write the c# script for the following psuedo code for the c# node in grasshopper for Rhino3d
# 
# //create a class for creating an interpolated point curve and a nurbs curve from points
# //Declare a curve variable
# //Create new instance of a curve from interpolate points
# 
# //Declare a curve variable
# //Create new instance of a curve from control points
# 
# //Assign output
panel_3 = Panel("1")
data_recorder_2 = DataRecorder(panel_3, DataLimit=-10, RecordData=False)
list_length_2 = ListLength(List=data_recorder_2)
testnumbereven = TestNumberEven(num=list_length_2)  # -> out, IsEven; inputs num: Int32
# ---------- testnumbereven: C# ----------
    int mod = num % 2;
    IsEven = (mod == 0 ? true : false);
# ---------- end testnumbereven ----------
panel_4 = Panel(list_length_2)
panel_5 = Panel(testnumbereven.IsEven)
panel_6 = Panel("C:\Users\Sculpture\Desktop\Openai\Key\KeyMichaelWickerson.txt")
panel_7 = Panel("""//Write the c# script for the following psuedo code for the c# node in grasshopper for Rhino3d

//create a script the generated a basic floorplan of the acropolis""")
send = BooleanToggle(True)
file = ReadFile(File=panel_6, PerLineParse=True)
panel_8 = Panel(file)
chatgpt = GhPythonScript(api_key=file, request=panel_7, send=send)  # -> answer; inputs send: Boolean
# ---------- chatgpt: Python ----------
__author__ = "peter"
__version__ = "2023.01.18"

#calling peters api key on local files, to do: add in more json promts that link to api calls. could be good for uv map generations. 

import rhinoscriptsyntax as rs
import urllib2
import json


url = "https://api.openai.com/v1/completions"


data = json.dumps({ "model": "text-davinci-003", "prompt": request, "temperature": 0.5,  "max_tokens": 1024})
headers = { "Content-Type": "application/json", "Authorization": "Bearer {0}".format(api_key) }

answer = "Send to request to Open AI"

if send:

    req = urllib2.Request(url, data, headers)
    response = urllib2.urlopen(req)


    response_text = response.read()
    response_json = json.loads(response_text)


    answer = response_json["choices"][0]["text"]

print(answer)
# ---------- end chatgpt ----------
panel_9 = Panel(chatgpt)
number_slider = Slider(3, range=0..10)
number_slider_2 = Slider(3, range=0..24)
number_slider_3 = Slider(3, range=0..24)
here = CSharpScript()  # -> out, here
# ---------- here: C# usings ----------
using System.IO;
# ---------- here: C# ----------
    string currentFolder = "";

    GH_Document doc = owner.OnPingDocument();
    string filePath = doc.FilePath;
    string pathOnly = Path.GetDirectoryName(filePath);

    here = pathOnly;
# ---------- end here ----------
range = Range(Domain=Slider(3, range=0..3), Steps=number_slider)
range_2 = Range(Domain=Slider(3, range=0..10), Steps=number_slider)
number_slider_4 = Slider(3, range=0..10)  # disabled
panel_10 = Panel(here.here)
number_slider_5 = Slider(10, range=0..10)  # disabled

# ----
# //Create an instance of a point and initialize to x, y and z
#     Point3d pt = new Point3d(x, y, z);
# 
# //Assign the point "pt" to output
#     Point = pt;
createpointintializexyz = CreatePointIntializeXYZ()  # -> out, Point; inputs x: Double, y: Double, z: Double; disabled
# ---------- createpointintializexyz: C# usings ----------
using System.IO;
using System.Linq;
using System.Data;
using System.Drawing;
using System.Reflection;
using System.Windows.Forms;
using System.Xml;
using System.Xml.Linq;
using System.Runtime.InteropServices;

using Rhino.DocObjects;
using Rhino.Collections;
using GH_IO;
using GH_IO.Serialization;
# ---------- createpointintializexyz: C# ----------
    //Create an instance of a point and initialize to x, y and z
    Point3d pt = new Point3d(x, y, z);

    //Assign the point "pt" to output
    Point = pt;
# ---------- end createpointintializexyz ----------

range_3 = Range(Domain=number_slider_5, Steps=10)  # disabled

createacropolisfloorplan_001 = CSharpScript(x=number_slider_3, y=number_slider_2, z=number_slider, uCount=range_2, vCount=range)  # -> out, A, B, C, D; inputs x: Int32, y: Int32, z: Int32, uCount: Int32, vCount: Int32
# ---------- createacropolisfloorplan_001: C# ----------
    //Write the c# script for the following psuedo code for the c# node in grasshopper for Rhino3d

//create a script the generated a basic floorplan of the acropolis
//Pseudo code:
//Create a point at the origin
Point3d origin = new Point3d(0,0,0);
//Create a plane at the origin
Plane originPlane = new Plane(origin, Vector3d.XAxis, Vector3d.YAxis);
//Create a line from the origin to the point x units away in the x direction
Line xLine = new Line(origin, new Point3d(x,0,0));
//find the length of the line
double xLength = xLine.Length;
//Create a line from the origin to the point y units away in the y direction
Line yLine = new Line(origin, new Point3d(0,y,0));
//find the length of the line
double yLength = yLine.Length;

//Create a line from the origin to a point z units away in the z direction
Line zLine = new Line(origin, new Point3d(0,0,z));
//Create a rectangle from the x and y lines
Rectangle3d rect = new Rectangle3d(originPlane, xLength, yLength);

//create a surface from the edge curves of the rectangle
Surface rectSurface = Surface.CreateExtrusion(rect.ToNurbsCurve(), zLine.Direction);

//evaluate the surface at the point (uCount, vCount)
Point3d surfacePoint = rectSurface.PointAt(uCount, vCount);

//Output the mesh
A = rect;
B = rectSurface;
C = surfacePoint;
# ---------- end createacropolisfloorplan_001 ----------
script_parasite = ScriptParasite(Enable=Toggle(False), Folder=here.here)

number_slider_6 = Slider(3, range=0..10)  # disabled
cosine_2 = Cosine(Value=range_3)  # disabled
surface = Surface(createacropolisfloorplan_001.B)
rectangle = Rectangle(createacropolisfloorplan_001.A)
point = Point(createacropolisfloorplan_001.C)
cap_holes = CapHoles(Brep=surface)
parasite_point_001 = CSharpScript(x=range_3, y=cosine_2, z=number_slider_6)  # -> out, ptOut; inputs x: Double, y: Double, z: Double; disabled
# ---------- parasite_point_001: C# ----------
  //Write the c# script for the following psuedo code for the c# node in grasshopper for Rhino3d
  
  //Create an instance of a point and initialize to x, y and z
  Point3d pt = new Point3d(x, y, z);

  //Assign the point "pt" to output
  ptOut = pt;
# ---------- end parasite_point_001 ----------
multiplication_2 = Multiplication(A=Slider(2, range=0..10), B=addition)
negative = Negative(Value=multiplication_2)
volume = Volume(Geometry=cap_holes)  # -> Volume, Centroid
point_2 = Point(parasite_point_001.ptOut)  # disabled

# ----
# //Declare a curve variable
#     Rhino.Geometry.Curve interCrv = default(Rhino.Geometry.Curve);
#     //Create new instance of a curve from interpolate points
#     interCrv = Rhino.Geometry.Curve.CreateInterpolatedCurve(points, degree);
# 
#     //Declare a curve variable
#     Rhino.Geometry.Curve nurbsCrv = default(Rhino.Geometry.Curve);
#     //Create new instance of a curve from control points
#     nurbsCrv = Rhino.Geometry.Curve.CreateControlPointCurve(points, degree);
# 
# 
#     Rhino.Geometry.Curve crv = Curve.CreateControlPointCurve(points, degree);
#     Rhino.Geometry.NurbsCurve nc = crv as Rhino.Geometry.NurbsCurve;
# 
#     //Assign output
#     InterpolateCrv = interCrv;
#     NurbsCrv = nurbsCrv;
classcreatenewnurbscurve = ClassCreateNewNURBSCurve(points=point_2, degree=number_slider_4)  # -> out, InterpolateCrv, NurbsCrv; inputs points: list of Point3d, degree: Int32; disabled
# ---------- classcreatenewnurbscurve: C# ----------
    //Declare a curve variable
    Rhino.Geometry.Curve interCrv = default(Rhino.Geometry.Curve);
    //Create new instance of a curve from interpolate points
    interCrv = Rhino.Geometry.Curve.CreateInterpolatedCurve(points, degree);

    //Declare a curve variable
    Rhino.Geometry.Curve nurbsCrv = default(Rhino.Geometry.Curve);
    //Create new instance of a curve from control points
    nurbsCrv = Rhino.Geometry.Curve.CreateControlPointCurve(points, degree);


    Rhino.Geometry.Curve crv = Curve.CreateControlPointCurve(points, degree);
    Rhino.Geometry.NurbsCurve nc = crv as Rhino.Geometry.NurbsCurve;

    //Assign output
    InterpolateCrv = interCrv;
    NurbsCrv = nurbsCrv;
# ---------- end classcreatenewnurbscurve ----------

point_3 = Point(point_2)  # disabled
createinterpandnurbscrvs = CSharpScript(points=point_3, degree=number_slider_4)  # -> out, InterpolateCrv, NurbsCrv; inputs points: list of Point3d, degree: Int32; disabled
# ---------- createinterpandnurbscrvs: C# ----------
    //Write the c# script for the following psuedo code for the c# node in grasshopper for Rhino3d

//Declare a curve variable
    Rhino.Geometry.Curve interCrv = default(Rhino.Geometry.Curve);
    //Create new instance of a curve from interpolate points
    interCrv = Rhino.Geometry.Curve.CreateInterpolatedCurve(points, degree);

    //Declare a curve variable
    Rhino.Geometry.Curve nurbsCrv = default(Rhino.Geometry.Curve);
    //Create new instance of a curve from control points
    nurbsCrv = Rhino.Geometry.Curve.CreateControlPointCurve(points, degree);


    Rhino.Geometry.Curve crv = Curve.CreateControlPointCurve(points, degree);
    Rhino.Geometry.NurbsCurve nc = crv as Rhino.Geometry.NurbsCurve;

    //Assign output
    InterpolateCrv = interCrv;
    NurbsCrv = nurbsCrv;
# ---------- end createinterpandnurbscrvs ----------
curve = Curve(createinterpandnurbscrvs.InterpolateCrv)  # disabled
curve_2 = Curve(createinterpandnurbscrvs.NurbsCrv)  # disabled
construct_domain = ConstructDomain(DomainStart=negative, DomainEnd=multiplication_2)
panel_11 = Panel(point_2)  # disabled
line = Line(StartPoint=volume.Centroid, EndPoint=point)  # -> graft(Line)
number_slider_7 = Slider(0.127, range=0..1)
boolean_toggle = BooleanToggle(True)
square = Square(Plane=PlaneXY(0, 0, 0), Size=number_slider, ExtentX=number_slider_3, ExtentY=number_slider_2)  # -> Cells, flatten(Points)
list_length_3 = ListLength(List=square.Points)
range_4 = Range(Domain=construct_domain, Steps=expr("x-1", list_length_3))
pi_2 = Pi(Factor=range_4)
list_item = ListItem(List=volume.Centroid, Index=0, Wrap=True)
multiplication_3 = Multiplication(A=cosine, B=pi_2)
jitter = Jitter(List=multiplication_3, Jitter=1, Seed=2)  # -> Values, Indices
unit_z = UnitZ(Factor=range_4)
rotate_3d = Rotate3D(Geometry=line, Angle=jitter.Values, Center=volume.Centroid, Axis=Vector(0, 0, 1))  # -> Geometry, Transform
orient = Orient(Geometry=rotate_3d.Geometry, Source=list_item, Target=square.Points)  # -> Geometry, Transform
move = Move(Geometry=orient.Geometry, Motion=unit_z)  # -> Geometry, Transform
mesh_pipe = MeshPipe(Polylines=move.Geometry, NumberOfSides=4, Tolerance=0.1, Radius=number_slider_7, Cap=boolean_toggle, Join=boolean_toggle)
rotate_3d_2 = Rotate3D(Geometry=mesh_pipe, Angle=range_4, Center=Point(0, 0, 0), Axis=Vector(0, 0, 1))  # -> Geometry, Transform
multipipe = MultiPipe(
    Curves=orient.Geometry,
    NodeSize=number_slider_7,
    EndOffset=1,
    StrutSize=1,
    Segment=0,
    KinkAngle=0.6,
    CubeFit=0,
    Caps="1")  # disabled
bake_geometry = BakeGeometry(Bake=Button(), Geometry=rotate_3d_2.Geometry, DeleteOldBakes=False, PreserveTrees=False)
