# Grasshopper definition ChatGPT_GH017.gh (Grasshopper 1.0.7)
# plug-ins: ScriptParasite, Kangaroo2 Components

# ----
# Bake Engine
trigger = Trigger(Interval=2000, TimerInterval=2000, Target=data_recorder)  # disabled
data_recorder = DataRecorder("1", DataLimit=-10, RecordData=False)
list_length = ListLength(List=data_recorder)
testnumbereven = TestNumberEven(num=list_length)  # -> out, IsEven; inputs num: Int32
# ---------- testnumbereven: C# ----------
    int mod = num % 2;
    IsEven = (mod == 0 ? true : false);
# ---------- end testnumbereven ----------
panel = Panel(list_length)
panel_2 = Panel(testnumbereven.IsEven)

panel_3 = Panel("C:\Users\Sculpture\Desktop\Openai\Key\KeyMichaelWickerson.txt")
panel_4 = Panel("""//Write the c# script for the following psuedo code for the c# node in grasshopper for Rhino3d

//create a script that generates a beautiful trigonometric curves for the keel, haul, and ribs of a boat""")
file = ReadFile(File=panel_3, PerLineParse=True)
send = BooleanToggle(True)
panel_5 = Panel(file)
chatgpt = GhPythonScript(api_key=file, request=panel_4, send=send)  # -> answer; inputs send: Boolean
# ---------- chatgpt: Python ----------
__author__ = "peter"
__version__ = "2023.01.18"

#calling peters api key on local files, to do: add in more json promts that link to api calls. could be good for uv map generations. 

import rhinoscriptsyntax as rs
import urllib2
import json


url = "https://api.openai.com/v1/completions"


data = json.dumps({ "model": "text-davinci-003", "prompt": request, "temperature": 0.5,  "max_tokens": 1024})
headers = { "Content-Type": "application/json", "Authorization": "Bearer {0}".format(api_key) }

answer = "Send to request to Open AI"

if send:

    req = urllib2.Request(url, data, headers)
    response = urllib2.urlopen(req)


    response_text = response.read()
    response_json = json.loads(response_text)


    answer = response_json["choices"][0]["text"]

print(answer)
# ---------- end chatgpt ----------
panel_6 = Panel(chatgpt)
here = CSharpScript()  # -> out, here
# ---------- here: C# usings ----------
using System.IO;
# ---------- here: C# ----------
    string currentFolder = "";

    GH_Document doc = owner.OnPingDocument();
    string filePath = doc.FilePath;
    string pathOnly = Path.GetDirectoryName(filePath);

    here = pathOnly;
# ---------- end here ----------
panel_7 = Panel(here.here)
pi = Pi(Factor=1)

createacropolisfloorplan_017 = CSharpScript(
    numPoints=Slider(100, range=0..100),
    amplitude=Slider(12, range=0..100),
    frequency=Slider(0.2, range=-0.2..0.2),
    phaseShift=pi)  # -> out, A, B, C; inputs numPoints: Int32, amplitude: Double, frequency: Double, phaseShift: Double
# ---------- createacropolisfloorplan_017: C# ----------
    //Write the c# script for the following psuedo code for the c# node in grasshopper for Rhino3d
      //Write the c# script for the following psuedo code for the c# node in grasshopper for Rhino3d

    //set the inputs on the c# node in grasshopper

    //define the points for the curves
    Point3d [] keelPoints = new Point3d[numPoints];
    Point3d [] haulPoinst = new Point3d[numPoints];
    Point3d [] ribPoints = new Point3d[numPoints];

    //calculate the points for the curves
    for (int i = 0; i < numPoints; i++)
    {
      double t = (double) i / (double) (numPoints - 1);
      double x = amplitude * Math.Sin(2 * Math.PI * frequency * t + phaseShift);
      double y = amplitude * Math.Cos(2 * Math.PI * frequency * t + phaseShift);
      double z = amplitude * Math.Tan(2 * Math.PI * frequency * t + phaseShift);

      keelPoints[i] = new Point3d(x, 0, z);
      haulPoinst[i] = new Point3d(x, y, 0);
      ribPoints[i] = new Point3d(0, y, z);
    }

    //output the curves
    Curve keelCurve = Curve.CreateInterpolatedCurve(keelPoints, 3);
    Curve haulCurve = Curve.CreateInterpolatedCurve(haulPoinst, 3);
    Curve ribCurve = Curve.CreateInterpolatedCurve(ribPoints, 3);

    //outputs
    A = keelCurve;
    B = haulCurve;
    C = ribCurve;
    //create a script that generates a beautiful trigonometric curves for the keel, haul, and ribs of a boat
# ---------- end createacropolisfloorplan_017 ----------
script_parasite = ScriptParasite(Enable=Toggle(True), Folder=here.here)

curve = Curve(createacropolisfloorplan_017.A)
curve_2 = Curve(createacropolisfloorplan_017.B)
curve_3 = Curve(createacropolisfloorplan_017.C)
end_points = EndPoints(Curve=curve)  # -> Start, End
end_points_2 = EndPoints(Curve=curve_2)  # -> Start, End
end_points_3 = EndPoints(Curve=curve_3)  # -> Start, End
line = Line(StartPoint=end_points.Start, EndPoint=end_points_3.Start)
line_2 = Line(StartPoint=end_points.End, EndPoint=end_points_2.End)
line_3 = Line(StartPoint=end_points_2.End, EndPoint=end_points.Start)
line_4 = Line(StartPoint=end_points.End, EndPoint=end_points_3.End)
yz_plane = YZPlane(Origin=Point(0, 0, 0))
xz_plane = XZPlane(Origin=Point(0, 0, 0))
xy_plane = XYPlane(Origin=Point(0, 0, 0))
merge = Merge(Data1=line, Data2=line_2, Data3=line_3, Data4=line_4, Data5=curve, Data6=curve_2, Data7=curve_3)
mirror = Mirror(Geometry=merge, Plane=graft([yz_plane, xz_plane]))  # -> Geometry, Transform
mirror_2 = Mirror(Geometry=mirror.Geometry, Plane=graft(xy_plane))  # -> Geometry, Transform
multipipe = MultiPipe(
    Curves=[mirror_2.Geometry, mirror.Geometry],
    NodeSize=Slider(2, range=0..2),
    EndOffset=1,
    StrutSize=1,
    Segment=0,
    KinkAngle=0.6,
    CubeFit=0,
    Caps=0)

# ----
# Oscillation Engine
trigger_2 = Trigger(Interval=20, TimerInterval=20, Target=data_recorder_2)  # disabled
data_recorder_2 = DataRecorder("1", DataLimit=10000, RecordData=False)
list_length_2 = ListLength(List=data_recorder_2)
panel_8 = Panel(list_length_2)
pi_2 = Pi(Factor=1)
division = Division(A=panel_8, B=Slider(159, range=1..220))
cosine = Cosine(Value=division)
sine = Sine(Value=division)
multiplication = Multiplication(A=cosine, B=pi_2)
absolute = Absolute(Value=multiplication)
panel_9 = Panel([cosine, sine])

multiplication_2 = Multiplication(A=cosine, B=pi_2)

absolute_2 = Absolute(Value=multiplication_2)
addition = Addition(A=absolute, B=absolute_2)
