# Grasshopper definition ChatGPT_GH020.gh (Grasshopper 1.0.7)
# plug-ins: ScriptParasite, Bifocals, Human

# ----
# Bake Engine
trigger = Trigger(Interval=1000, TimerInterval=1000, Target=data_recorder)  # disabled
data_recorder = DataRecorder("1", DataLimit=-10, RecordData=False)
list_length = ListLength(List=data_recorder)
testnumbereven = TestNumberEven(num=list_length)  # -> out, IsEven; inputs num: Int32
# ---------- testnumbereven: C# ----------
    int mod = num % 2;
    IsEven = (mod == 0 ? true : false);
# ---------- end testnumbereven ----------
panel = Panel(list_length)
panel_2 = Panel(testnumbereven.IsEven)

panel_3 = Panel("C:\Users\mwickerson\Desktop\OpenAI\Key\KeyMichaelWickerson.txt")
panel_4 = Panel("""//Write the c# script for the following psuedo code for the c# node in grasshopper for Rhino3d

//create a curve for a robotic tool path that maps our the best permiculture layout for an irregular surface that represents a 20 acre farm""")
read_file = ReadFile(File=panel_3, PerLineParse=True)
send = BooleanToggle(True)
button = Button()  # disabled
panel_5 = Panel(read_file)
chatgpt = GhPythonScript(api_key=read_file, request=panel_4, send=send)  # -> answer; inputs send: Boolean
# ---------- chatgpt: Python ----------
__author__ = "peter"
__version__ = "2023.01.18"

#calling peters api key on local files, to do: add in more json promts that link to api calls. could be good for uv map generations. 

import rhinoscriptsyntax as rs
import urllib2
import json


url = "https://api.openai.com/v1/completions"


data = json.dumps({ "model": "text-davinci-003", "prompt": request, "temperature": 0.5,  "max_tokens": 1024})
headers = { "Content-Type": "application/json", "Authorization": "Bearer {0}".format(api_key) }

answer = "Send to request to Open AI"

if send:

    req = urllib2.Request(url, data, headers)
    response = urllib2.urlopen(req)


    response_text = response.read()
    response_json = json.loads(response_text)


    answer = response_json["choices"][0]["text"]

print(answer)
# ---------- end chatgpt ----------
here = CSharpScript()  # -> out, here
# ---------- here: C# usings ----------
using System.IO;
# ---------- here: C# ----------
    string currentFolder = "";

    GH_Document doc = owner.OnPingDocument();
    string filePath = doc.FilePath;
    string pathOnly = Path.GetDirectoryName(filePath);

    here = pathOnly;
# ---------- end here ----------
panel_6 = Panel(here.here)
number_slider = Slider(100, range=0..100)
panel_7 = Panel(chatgpt)
pi = Pi(Factor=1)

# ----
# Oscillation Engine
trigger_2 = Trigger(Interval=20, TimerInterval=20, Target=data_recorder_2)
data_recorder_2 = DataRecorder("1", DataLimit=10000, RecordData=True)
list_length_2 = ListLength(List=data_recorder_2)
panel_8 = Panel(list_length_2)
pi_2 = Pi(Factor=1)
division = Division(A=panel_8, B=Slider(71, range=1..220))
cosine = Cosine(Value=division)
sine = Sine(Value=division)
multiplication = Multiplication(A=cosine, B=pi_2)
absolute = Absolute(Value=multiplication)
panel_9 = Panel([cosine, sine])

multiplication_2 = Multiplication(A=cosine, B=pi_2)

absolute_2 = Absolute(Value=multiplication_2)
addition = Addition(A=absolute, B=absolute_2)

multiplication_3 = Multiplication(A=sine, B=Slider(0.2, range=-0.2..0.2))
multiplication_4 = Multiplication(A=cosine, B=Slider(7.123, range=0..10))

createrobotictoolpath_020 = CSharpScript(frequency=multiplication_3, amplitude=multiplication_4)  # -> out, A, B, C, D, E; inputs frequency: Double, amplitude: Double
# ---------- createrobotictoolpath_020: C# ----------
    //Write the c# script for the following psuedo code for the c# node in grasshopper for Rhino3d
    //create a curve for a robotic tool path that maps our the best permiculture 
    //layout for an trigonometeric surface that represents a 20 acre farm
    //Create a new curve object with rhino common
    Curve myCurve = Rhino.Geometry.Curve.CreateControlPointCurve(new Point3d[] { new Point3d(0, 0, 0), new Point3d(1, 0, 0), new Point3d(1, 1, 0), new Point3d(0, 1, 0) }, 3);

    //Define the parameters for the curve
    double[] myCurveParameters = myCurve.DivideByCount(10, true);
    myCurve.Domain = new Interval(0, 1);

    //create a list of points to define the curve
    List<Point3d> points = new List<Point3d>();

    //Loop through the surface to create the points for the curve with frequency and amplitude
    for (int i = 0; i < 20; i++)
    {
      for (int j = 0; j < 20; j++)
      {
        Point3d point = new Point3d(i, j, amplitude * Math.Sin(frequency * i) * Math.Cos(frequency * j));
        points.Add(point);
      }

      //Create the curve from the points
      myCurve = Rhino.Geometry.Curve.CreateControlPointCurve(points, 3);


      //Outputs
      A = myCurve;
      B = myCurveParameters;
      C = myCurve.Domain;
      D = points;
      E = myCurve;


    }
    



    //Outputs
    A = myCurve;
    B = myCurveParameters;
    C = myCurve.Domain;
# ---------- end createrobotictoolpath_020 ----------
script_parasite = ScriptParasite(Enable=Toggle(True), Folder=here.here)

number = Number(createrobotictoolpath_020.B)
domain = Domain(createrobotictoolpath_020.C)
curve = Curve(createrobotictoolpath_020.A)
point = Point(createrobotictoolpath_020.D)
curve_2 = Curve(createrobotictoolpath_020.E)
bake_geometry = BakeGeometry(Bake=Button(), Geometry=curve_2, DeleteOldBakes=False, PreserveTrees=False)
